# Grasshopper definition point_cloud.gh (Grasshopper 0.9.76)

h_cabo_sup = Slider(4, range=0..8)
largura_apoios = Slider(16, range=0..30)
n_cabos = Slider(1, range=0..8)
horiz_div = Slider(6, range=5..20)
subdiv = Slider(6, range=1..6)
deltah = Slider(4, range=2..20)
c_script = CSharpScript(Largura=largura_apoios, N_cabos=n_cabos, Altura=h_cabo_sup, delta_h=deltah, horiz_div=horiz_div, subdiv=subdiv)  # -> out, A; inputs Largura: Double, N_cabos: Int32, Altura: Int32, delta_h: Int32, horiz_div: Int32, subdiv: Double
# ---------- c_script: C# ----------
                                            /*int i = 0;
    List<Point3d> Pts = new List<Point3d>();
    for (i = 0;i <= N_apoios;i++)
    {
      Pts.Add(new Point3d(0, Altura[i], 0));
    }
    A = Pts;*/
    List<Point3d> Pt_cloud = new List<Point3d>();

    //Pts apoio
    Pt_cloud.Add(new Point3d(0, 0, 0));
    Pt_cloud.Add(new Point3d(Largura, 0, 0));
    Pt_cloud.Add(new Point3d(Largura, Largura, 0));
    Pt_cloud.Add(new Point3d(0, Largura, 0));

    int x = 0;
    int y = 1;
    int h = 2;
    bool reverse = false;
    //main pt cloud loop

    //add for loop with H
    //for(int h=0,....
    // x & y ++

    if(!reverse){
      for(x = 0;x <= subdiv; x++){
        Pt_cloud.Add(new Point3d(x * (Largura / subdiv), 0, h));

        if (x == subdiv){
          for(y = 1;y <= subdiv; y++){
            Pt_cloud.Add(new Point3d(Largura, y * (Largura / subdiv), h));

            if(x == subdiv && y == subdiv){reverse = true;} // start backwards loop

          }
        }
      }
    }
    if(reverse){
      for(x = (int) subdiv;x >= 0; x--){
        Pt_cloud.Add(new Point3d(x * (Largura / subdiv), Largura, h));

        if (x == 0){
          for(y = (int) subdiv;y >= 1; y--){
            Pt_cloud.Add(new Point3d(0, y * (Largura / subdiv), h));


          }
        }
      }
    }

    A = Pt_cloud;
# ---------- end c_script ----------
panel = Panel(c_script.A)
